# Grasshopper definition FURobotPython.gh (Grasshopper 1.0.7)
# plug-ins: FURobot

create_euler_angles = CreateEulerAngles(A=Slider(19.48, range=-90..90), B=Slider(14.9, range=-90..90), C=Slider(20.97, range=-90..90))
rotation_parameter_conversion = RotationParameterConversion(Euler=create_euler_angles, Input=0, Output=5)  # -> Euler, Matrix, Quat, AxisAng, RotateVec
vec = VectorXYZ(XComponent=Slider(1000, range=0..1000), YComponent=Slider(300, range=0..1000), ZComponent=Slider(500, range=0..1000))  # -> Vector, Length
move = Move(Motion=vec.Vector)  # -> Geometry, Transform
merge = Merge(Data1=rotation_parameter_conversion.Matrix, Data2=move.Transform)
comp = Compound(Transforms=merge)
matrix = DisplayMatrix(comp)
python = GhPythonScript(TF=comp)  # -> out, Euler, a, b, c, x, y, z; inputs TF: Transform
# ---------- python: Python ----------
__author__ = "LmShare"
__version__ = "2024.04.03"

import rhinoscriptsyntax as rs
import sys
import clr
import Rhino

sys.path.append('C:\gha\FUROBOT')
clr.AddReference('FUMath')
clr.AddReference('FUROBOTCore')
import MyMath
import FUROBOTCore

x=TF[0,3]
y=TF[1,3]
z=TF[2,3]

rh_mat=Rhino.Geometry.Matrix(TF)

order=MyMath.EulerAngleOrder.ZYX

rh_tf=FUROBOTCore.MathCommon.ConvertToTransform(rh_mat)
rigid_tf=FUROBOTCore.MathCommon.GetRigidTransform(rh_tf)


euler_angle=MyMath.EulerAngle(rigid_tf,order)

a=euler_angle.A_deg;
b=euler_angle.B_deg;
c=euler_angle.C_deg;

Euler=euler_angle
# ---------- end python ----------
panel = Panel(python.Euler)

panel_2 = Panel(python.x)
panel_3 = Panel(python.y)
panel_4 = Panel(python.z)

panel_5 = Panel(python.a)
panel_6 = Panel(python.b)
panel_7 = Panel(python.c)
