# Grasshopper definition 避障.gh (Grasshopper 1.0.7)
# plug-ins: RobotKUKA, FURobot

crv = Curve(<curve referenced from the Rhino model>)

# ---- group: 初始姿态
merge = Merge(
    Data1=Slider(33.35, range=-90..90),
    Data2=Slider(-90, range=-90..90),
    Data3=Slider(117.05, range=0..1000),
    Data4=Slider(0, range=0..100),
    Data5=Slider(-68, range=-100..-68),
    Data6=Slider(0, range=-90..90))

# ----
divide = DivideCurve(Curve=crv, Count=Slider(1, range=0..1), Kinks=False)  # -> Points, Tangents, Parameters
tcp_for_rotating_kuka = TCPForRotatingKUKA(Plane=divide.Points)

# ---- group: Pose to joint command
generate_nan = GenerateNaN()
generate_nan_2 = GenerateNaN()
generate_nan_3 = GenerateNaN()
generate_nan_4 = GenerateNaN()
generate_nan_5 = GenerateNaN()
generate_nan_6 = GenerateNaN()
merge_2 = Merge(
    Data1=generate_nan,
    Data2=generate_nan_2,
    Data3=generate_nan_3,
    Data4=generate_nan_4,
    Data5=generate_nan_5,
    Data6=generate_nan_6)
pose_to_joint_command = PoseToJointCommand(
    Plane=tcp_for_rotating_kuka,
    RotJointVel=Slider(20, range=1..100),
    MovJointVel=Slider(100, range=1..300),
    FixedValue=merge_2)

# ----
panel = Panel(merge)

# ---- group: Joint cmd
joint_cmd = JointCmd(Joint=merge, RotJointVel=Slider(20, range=1..100), MovJointVel=Slider(100, range=1..300))

merge_3 = Merge(
    Data1=Slider(52.81, range=-90..90),
    Data2=Slider(-88.23, range=-90..90),
    Data3=Slider(102.31, range=0..1000),
    Data4=Slider(0, range=0..100),
    Data5=Slider(-68, range=-100..-68),
    Data6=Slider(0, range=-90..90))
joint_cmd_2 = JointCmd(Joint=merge_3, RotJointVel=Slider(20, range=1..100), MovJointVel=Slider(100, range=1..300))

# ----
light_plastic_tool_head = LightPlasticToolHead(Normal=0, Usage=0)
R = AgilusKR6KR10R900(Tool=light_plastic_tool_head)

merge_4 = Merge(Data1=joint_cmd, Data2=joint_cmd_2, Data3=pose_to_joint_command)

# ---- group: 障碍物体
mesh = Mesh(<mesh referenced from the Rhino model>)
mesh_2 = Mesh(<mesh referenced from the Rhino model>)
merge_5 = Merge(Data1=mesh, Data2=mesh_2)

# ----
simulator = RobotSimulator(Slider=Slider(1, range=0..1), Robot=R, CMD=merge_4, Mesh=merge_5)  # -> Joint, Geo, Traj, Task, PLane
